# Dynamo graph Civil3D_LayersToModel.dyn (Dynamo 2.5.2.7915)

file_path = Filename(".\layerCoordinates_left.xlsx")
file_from_path = FileObject(path=file_path)
code_block = CodeBlock { "left"; false; true; }
importExcel = Data.ImportExcel(file=file_from_path, sheetName=code_block.out0, readAsStrings=code_block.out1, showExcel=code_block.out2)
code_block_2 = CodeBlock { 0; }
removeItemAtIndex = List.RemoveItemAtIndex(list=importExcel, indices=code_block_2)
transpose = List.Transpose(lists=removeItemAtIndex)
KMS = CodeBlock(a=transpose) { a[0]; }
COORDINATES = CodeBlock(a=transpose) { a[1]; }
python_script = Python(IN[0]=KMS, IN[1]=COORDINATES)
# ---------- python_script.python (86 lines) ----------
__author__ = 'Goncalo Bastos - bastos.g.goncalo@gmail.com'
__copyright__ = '2022'
__version__ = '1.0.0'

##############################################################

# Load the Python Standard and DesignScript Libraries
import sys
import clr

# Add Assemblies for AutoCAD and Civil3D
clr.AddReference('AcMgd')
clr.AddReference('AcCoreMgd')
clr.AddReference('AcDbMgd')
clr.AddReference('AecBaseMgd')
clr.AddReference('AecPropDataMgd')
clr.AddReference('AeccDbMgd')
clr.AddReference('ProtoGeometry')
clr.AddReference('AutoCADNodes')
clr.AddReference('Civil3DNodes')   
clr.AddReference('Autodesk.Civil3DToolkit')
clr.AddReference('DSCoreNodes')

# Import references from AutoCAD
from Autodesk.AutoCAD.Runtime import *
from Autodesk.AutoCAD.ApplicationServices import *
from Autodesk.AutoCAD.EditorInput import *
from Autodesk.AutoCAD.DatabaseServices import *
from Autodesk.AutoCAD.Geometry import *

# Import references from Civil3D
from Autodesk.Civil.ApplicationServices import *
from Autodesk.Civil.DatabaseServices import *

# Import references from Dynamo
import Autodesk.AutoCAD.DynamoNodes as DA
import Autodesk.Civil.DynamoNodes as DC
import Autodesk.DesignScript.Geometry as DS
import DSCore
from Autodesk.AutoCAD.DynamoNodes import *
from Autodesk.Civil.DynamoNodes import *
#from Autodesk.DesignScript.Geometry import *
from DSCore import *


##############################################################

KMS = IN[0]
COORDINATES = IN[1]

rects = []

for coordinate in COORDINATES:

	coord_ = coordinate.replace("(","")
	coord_ = coord_.replace(")","")	
	coord_ = coord_.strip("][").split(", ")	
	coord_ = [float(i) for i in coord_]
	

	if len(coord_) == 1:
		pass
	else:
		c_iter = iter(coord_)
		
		for x1,y1,x2,y2,x3,y3,x4,y4 in zip(c_iter,c_iter,c_iter,c_iter,c_iter,c_iter,c_iter,c_iter):
			p1_ = DS.Point.ByCoordinates(x1,y1,0)
			p2_ = DS.Point.ByCoordinates(x2,y2,0)
			p3_ = DS.Point.ByCoordinates(x3,y3,0)
			p4_ = DS.Point.ByCoordinates(x4,y4,0)
			
			

			try:
				#layer = DS.PolyCurve.ByPoints([p1_,p2_,p3_,p4_],False)
				#layer = DS.Polygon.ByPoints([p1_,p2_,p3_,p4_])
				rects.append([p1_,p2_,p4_,p3_,p1_])
			except:
				pass
			

			
			


OUT = rects
# ----------------------------------------
byPoints = Polygon.ByPoints(points=python_script)
code_block_3 = CodeBlock { "@AUX"; }
current = Autodesk.AutoCAD.DynamoNodes.Document.Current()
modelSpace = Autodesk.AutoCAD.DynamoNodes.Document.ModelSpace(document=current)
byGeometry = Autodesk.AutoCAD.DynamoNodes.Object.ByGeometry(geometry=byPoints, layer=code_block_3, block=modelSpace)  # frozen
code_block_4 = CodeBlock(a=python_script) { a[0]; true; }
byPoints_2 = Autodesk.AutoCAD.DynamoNodes.Polyline.ByPoints(points=python_script, layer=code_block_3, block=modelSpace)
count = List.Count(list=python_script, lacing=CrossProduct)
