# Dynamo graph Civil3D_LayersToModel.dyn (Dynamo 2.5.2.7915)

file_path = Filename("..\output\layerCoordinates_left.xlsx")
file_from_path = FileObject(path=file_path)
code_block = CodeBlock { "left"; true; true; }
importExcel = Data.ImportExcel(file=file_from_path, sheetName=code_block.out0, readAsStrings=code_block.out1, showExcel=code_block.out2)
code_block_2 = CodeBlock { 0; }
removeItemAtIndex = List.RemoveItemAtIndex(list=importExcel, indices=code_block_2)
transpose = List.Transpose(lists=removeItemAtIndex)
KMS = CodeBlock(a=transpose) { a[0]; }
COORDINATES = CodeBlock(a=transpose) { a[1]; }
python_script = Python(IN[0]=KMS, IN[1]=COORDINATES)
# ---------- python_script.python (87 lines) ----------
__author__ = 'Goncalo Bastos - bastos.g.goncalo@gmail.com'
__copyright__ = '2022'
__version__ = '1.0.0'

##############################################################

# Load the Python Standard and DesignScript Libraries
import sys
import clr

# Add Assemblies for AutoCAD and Civil3D
clr.AddReference('AcMgd')
clr.AddReference('AcCoreMgd')
clr.AddReference('AcDbMgd')
clr.AddReference('AecBaseMgd')
clr.AddReference('AecPropDataMgd')
clr.AddReference('AeccDbMgd')
clr.AddReference('ProtoGeometry')
clr.AddReference('AutoCADNodes')
clr.AddReference('Civil3DNodes')   
clr.AddReference('Autodesk.Civil3DToolkit')
clr.AddReference('DSCoreNodes')

# Import references from AutoCAD
from Autodesk.AutoCAD.Runtime import *
from Autodesk.AutoCAD.ApplicationServices import *
from Autodesk.AutoCAD.EditorInput import *
from Autodesk.AutoCAD.DatabaseServices import *
from Autodesk.AutoCAD.Geometry import *

# Import references from Civil3D
from Autodesk.Civil.ApplicationServices import *
from Autodesk.Civil.DatabaseServices import *

# Import references from Dynamo
import Autodesk.AutoCAD.DynamoNodes as DA
import Autodesk.Civil.DynamoNodes as DC
import Autodesk.DesignScript.Geometry as DS
import DSCore
from Autodesk.AutoCAD.DynamoNodes import *
from Autodesk.Civil.DynamoNodes import *
#from Autodesk.DesignScript.Geometry import *
from DSCore import *


##############################################################

KMS = IN[0]
COORDINATES = IN[1]

rects = []
kms_ = []

for coordinate in COORDINATES:

	coord_ = coordinate.replace("(","")
	coord_ = coord_.replace(")","")	
	coord_ = coord_.strip("][").split(", ")	
	coord_ = [float(i) for i in coord_]
	

	if len(coord_) == 1:
		pass
	else:
		c_iter = iter(coord_)
		
		for x1,y1,x2,y2,x3,y3,x4,y4 in zip(c_iter,c_iter,c_iter,c_iter,c_iter,c_iter,c_iter,c_iter):
			p1_ = DS.Point.ByCoordinates(x1,y1,0)
			p2_ = DS.Point.ByCoordinates(x2,y2,0)
			p3_ = DS.Point.ByCoordinates(x3,y3,0)
			p4_ = DS.Point.ByCoordinates(x4,y4,0)
			
			p_km = DS.Point.ByCoordinates(0,y1,0)

			try:
				#layer = DS.PolyCurve.ByPoints([p1_,p2_,p3_,p4_],False)
				#layer = DS.Polygon.ByPoints([p1_,p2_,p3_,p4_])
				rects.append([p1_,p2_,p4_,p3_,p1_])
				kms_.append(p_km)
			except:
				pass
			

					


OUT = rects,kms_
# ----------------------------------------
code_block_3 = CodeBlock(a=python_script) { a[0]; }
code_block_4 = CodeBlock { "@AUX"; }
current = Autodesk.AutoCAD.DynamoNodes.Document.Current()
modelSpace = Autodesk.AutoCAD.DynamoNodes.Document.ModelSpace(document=current)
byPoints = Autodesk.AutoCAD.DynamoNodes.Polyline.ByPoints(points=code_block_3, layer=code_block_4, block=modelSpace)
python_script_2 = Python(IN[0]=KMS)
# ---------- python_script_2.python (58 lines) ----------
__author__ = 'Goncalo Bastos - bastos.g.goncalo@gmail.com'
__copyright__ = '2022'
__version__ = '1.0.0'

##############################################################

# Load the Python Standard and DesignScript Libraries
import sys
import clr

# Add Assemblies for AutoCAD and Civil3D
clr.AddReference('AcMgd')
clr.AddReference('AcCoreMgd')
clr.AddReference('AcDbMgd')
clr.AddReference('AecBaseMgd')
clr.AddReference('AecPropDataMgd')
clr.AddReference('AeccDbMgd')
clr.AddReference('ProtoGeometry')
clr.AddReference('AutoCADNodes')
clr.AddReference('Civil3DNodes')   
clr.AddReference('Autodesk.Civil3DToolkit')
clr.AddReference('DSCoreNodes')

# Import references from AutoCAD
from Autodesk.AutoCAD.Runtime import *
from Autodesk.AutoCAD.ApplicationServices import *
from Autodesk.AutoCAD.EditorInput import *
from Autodesk.AutoCAD.DatabaseServices import *
from Autodesk.AutoCAD.Geometry import *

# Import references from Civil3D
from Autodesk.Civil.ApplicationServices import *
from Autodesk.Civil.DatabaseServices import *

# Import references from Dynamo
import Autodesk.AutoCAD.DynamoNodes as DA
import Autodesk.Civil.DynamoNodes as DC
import Autodesk.DesignScript.Geometry as DS
import DSCore
from Autodesk.AutoCAD.DynamoNodes import *
from Autodesk.Civil.DynamoNodes import *
#from Autodesk.DesignScript.Geometry import *
from DSCore import *


##############################################################

kms = IN[0]

ys = list(range(0,len(kms)))
out_ = []

for i in ys:
	out_.append(DS.Point.ByCoordinates(-20,i,0))



OUT = out_
# ----------------------------------------
create = Autodesk.AutoCAD.DynamoNodes.MText.Create(text=KMS, insertionPoint=python_script_2, layer=code_block_4, block=modelSpace)
file_path_2 = Filename("..\output\layerCoordinates_right.xlsx")
file_from_path_2 = FileObject(path=file_path_2)
code_block_5 = CodeBlock { "right"; true; true; }
importExcel_2 = Data.ImportExcel(file=file_from_path_2, sheetName=code_block_5.out0, readAsStrings=code_block_5.out1, showExcel=code_block_5.out2)
removeItemAtIndex_2 = List.RemoveItemAtIndex(list=importExcel_2, indices=code_block_2)
transpose_2 = List.Transpose(lists=removeItemAtIndex_2)
KMS_2 = CodeBlock(a=transpose_2) { a[0]; }
COORDINATES_2 = CodeBlock(a=transpose_2) { a[1]; }
python_script_3 = Python(IN[0]=KMS_2, IN[1]=COORDINATES_2)  # same code as python_script
code_block_6 = CodeBlock(a=python_script_3) { a[0]; }
byPoints_2 = Autodesk.AutoCAD.DynamoNodes.Polyline.ByPoints(points=code_block_6, layer=code_block_4, block=modelSpace)
