# Dynamo graph Civil3D_LayersToSectionView.dyn (Dynamo 2.5.2.7915)
# packages: Civil3DToolkit 1.1.30, Camber 1.0.1

# group: SECTION VIEWS STATIONS
current = Autodesk.AutoCAD.DynamoNodes.Document.Current()
modelSpace = Autodesk.AutoCAD.DynamoNodes.Document.ModelSpace(document=current)
getSectionViews = Autodesk.Civil.DynamoNodes.SectionView.GetSectionViews(block=modelSpace)
name = Autodesk.Civil.DynamoNodes.SectionView.Name(sectionView=getSectionViews)
code_block = CodeBlock { " "; }
split = String.Split(str=name, separator0=code_block)
transpose = List.Transpose(lists=split)
code_block_2 = CodeBlock(a=transpose) { a[0]; "+"; ""; ".00"; }
replace = String.Replace(str=code_block_2.out0, searchFor=code_block_2.out1, replaceWith=code_block_2.out2)
replace_2 = String.Replace(str=replace, searchFor=code_block_2.out3, replaceWith=code_block_2.out2)

# group: STATION AND PROFILE DATA
file_path = Filename("..\src\DATA.xlsx")
file_from_path = FileObject(path=file_path)
code_block_3 = CodeBlock { "Sheet1"; false; }
importExcel = Data.ImportExcel(file=file_from_path, sheetName=code_block_3.out0, readAsStrings=code_block_3.out1, showExcel=code_block_3.out1)
code_block_4 = CodeBlock { 1; }
dropItems = List.DropItems(list=importExcel, amount=code_block_4)
transpose_2 = List.Transpose(lists=dropItems)
code_block_5 = CodeBlock(a=transpose_2) { a[0]; a[-1]; }
string_from_object = FromObject(obj=code_block_5.out0)
code_block_6 = CodeBlock { "."; }
split_2 = String.Split(str=string_from_object, separator0=code_block_6)
transpose_3 = List.Transpose(lists=split_2)
code_block_7 = CodeBlock(a=transpose_3) { a[0]; }
python_script = Python(IN[0]=replace_2, IN[1]=code_block_7)
# ---------- python_script.python (18 lines) ----------
__author__ = 'Goncalo Bastos - bastos.g.goncalo@gmail.com'
__copyright__ = '2022'
__version__ = '1.0.0'

##############################################################

pts = IN[0]
kms = IN[1]

bools = []

for km in kms:
	if km in pts:
		bools.append(True)
	else:
		bools.append(False)
		
OUT = bools
# ----------------------------------------

# group: SECTIONV VIEW COORDINATES
getFromCivilObject = Camber.Civil.SectionView.GetFromCivilObject(civilObject=getSectionViews)
code_block_8 = CodeBlock { 0; 1; }
filterByBoolMask = List.FilterByBoolMask(list=code_block_5.out1, mask=python_script)
getPointAtOffsetElevation = Camber.Civil.SectionView.GetPointAtOffsetElevation(sectionView=getFromCivilObject, offset=code_block_8.out0, elevation=filterByBoolMask.in)
X = Point.X(point=getPointAtOffsetElevation)
Y = Point.Y(point=getPointAtOffsetElevation)
list_create = List.Create(item0=replace_2, item1=X, item2=Y)
transpose_4 = List.Transpose(lists=list_create)

# group: EXPORT DATA
directory_path = Directory("C:\Users\GGB\Desktop")
string = StringInput("\")
string_2 = StringInput("<File Name>")  # graph input
concat = String.Concat(string0=directory_path, string1=string, string2=string_2)
code_block_9 = CodeBlock { "Sheet1"; 0; true; }
exportExcel = Data.ExportExcel(filePath=concat, sheetName=code_block_9.out0, startRow=code_block_9.out1, startCol=code_block_9.out1, data=transpose_4, overWrite=code_block_9.out2)
